# Grasshopper definition Demo.gh (Grasshopper 1.0.7)
# plug-ins: RodSteward

# ---- group: From Mesh Demo
number_slider = Slider(3.2, range=0..10)
number_slider_2 = Slider(1000, range=0..1000)
number_slider_3 = Slider(36, range=0..100)
number_slider_4 = Slider(0.02, range=0..3)
number_slider_5 = Slider(11.9, range=3..20)
panel = Panel("C:\RS-GH_Demo_1")
number_slider_6 = Slider(3, range=3..10)
button = Button()
msphereex = MeshSphereEx(Base=PlaneXY(0, 0, 0), Radius="1000", Count=Slider(3, range=0..10))
rsmesh2graph = Mesh2Graph(Mesh=msphereex)  # -> Edges, Vertices

# ----
rsgenerator = Generator(
    Edges=rsmesh2graph.Edges,
    Vertices=rsmesh2graph.Vertices,
    Sides=number_slider_6,
    Radius=number_slider_5,
    JointThickness=number_slider,
    JointLength=number_slider_3,
    Tolerance=number_slider_4,
    annotatejointarms=False,
    annotatejoints=False,
    annotaterods=False,
    collision=False,
    printlabel=False)  # -> Model, Joints, Rods, RodCurves
rsoutputrodcutsvg = OutputRodCutSVG(Model=rsgenerator.Model, StockLength=number_slider_2, Directory=panel, WriteTrigger=button)  # -> Output, CuttingPlan
rsoutputjointstl = OutputJointSTL(Model=rsgenerator.Model, Directory=panel, WriteTrigger=button)

# ---- group: From Mesh Demo (continued)
panel_2 = Panel(rsoutputjointstl)
panel_3 = Panel(rsoutputrodcutsvg.Output)
panel_4 = Panel(rsoutputrodcutsvg.CuttingPlan)

# ---- group: From Lines Demo
number_slider_7 = Slider(3.2, range=0..10)
number_slider_8 = Slider(1000, range=0..1000)
number_slider_9 = Slider(36, range=0..100)
number_slider_10 = Slider(0.02, range=0..3)
number_slider_11 = Slider(10.6, range=3..20)
panel_5 = Panel("C:\RS-GH_Demo_2")
number_slider_12 = Slider(3, range=3..10)
button_2 = Button()
scale = Scale(Geometry=msphereex, Center=Point(0, 0, 0), Factor="0.5")  # -> Geometry, Transform
medges = MeshEdges(Mesh=scale.Geometry)  # -> NakedEdges, InteriorEdges, NonManifoldEdges
rslines2graph = Lines2Graph(Lines=medges.InteriorEdges, Tolerance="10")  # -> Edges, Vertices

# ----
rsgenerator_2 = Generator(
    Edges=rslines2graph.Edges,
    Vertices=rslines2graph.Vertices,
    Sides=number_slider_12,
    Radius=number_slider_11,
    JointThickness=number_slider_7,
    JointLength=number_slider_9,
    Tolerance=number_slider_10,
    annotatejointarms=False,
    annotatejoints=False,
    annotaterods=False,
    collision=False,
    printlabel=False)  # -> Model, Joints, Rods, RodCurves
rsoutputrodcutsvg_2 = OutputRodCutSVG(Model=rsgenerator_2.Model, StockLength=number_slider_8, Directory=panel_5, WriteTrigger=button_2)  # -> Output, CuttingPlan
rsoutputjointstl_2 = OutputJointSTL(Model=rsgenerator_2.Model, Directory=panel_5, WriteTrigger=button_2)

# ---- group: From Lines Demo (continued)
panel_6 = Panel(rsoutputrodcutsvg_2.CuttingPlan)
panel_7 = Panel(rsoutputjointstl_2)
panel_8 = Panel(rsoutputrodcutsvg_2.Output)
